# Grasshopper definition surface_mapping_network.gh (Grasshopper 1.0.4)

number_slider = Slider(3000, range=0..3000)
number_slider_2 = Slider(3, range=0..10)
planesrf = PlaneSurface(Plane=PlaneXY(0, 0, 0), XSize=number_slider, YSize=number_slider)
series = Series(Start=0, Step=number_slider, Count=number_slider_2)
series_2 = Series(Start=0, Step=number_slider, Count=Slider(4, range=0..10))

# ---- group: cylinder as looping surfaces
cyl = Cylinder(Base=PlaneXY(0, 0, 0), Radius=Slider(3500, range=0..4000), Length=Slider(9000, range=0..10000))
python = GhPythonScript()  # -> out, a
# ---------- python: Python ----------
__author__ = "ytakzk"
__version__ = "2019.02.23"

import Rhino.Geometry as rg

a = []

for i in range(3):
    
    a.append(rg.Interval(i/3, (i + 1)/3))
# ---------- end python ----------
dom² = ConstructDomain²(DomainU=python.a, DomainV=graft(python.a))  # -> flatten(_2DDomain)
subsrf = Isotrim(Surface=reparameterize(cyl), Domain=dom²)
python_2 = GhPythonScript(x=subsrf)  # -> out, a; inputs x: list of Surface
# ---------- python_2: Python ----------
__author__ = "ytakzk"
__version__ = "2019.02.23"

import Rhino.Geometry as rg

for s in x[3:6]:

    s.Reverse(0, True)
    domain = rg.Interval(0, 1)
    s.SetDomain(0, domain)

import random
random.shuffle(x)
a = x
# ---------- end python_2 ----------

# ----
X = UnitX(Factor=series)
Y = UnitY(Factor=series_2)  # -> graft(UnitVector)
move = Move(Geometry=planesrf, Motion=X)  # -> Geometry, Transform
move_2 = Move(Geometry=move.Geometry, Motion=Y)  # -> flatten(Geometry), Transform
srf = Surface(move_2.Geometry)
srf_2 = Surface([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])

# ---- group: Jonas's surfaces
srf_3 = Surface([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])
python_3 = GhPythonScript(surfaces=srf_2)  # -> out, a; inputs surfaces: list of Surface
# ---------- python_3: Python ----------
__author__ = "ytakzk"
__version__ = "2019.02.24"

import Rhino.Geometry as rg

a = []

for i, s in enumerate(surfaces):
    
    domain = rg.Interval(0, 1)
    
    if i > 1:
        s = s.Reverse(0)
        s.SetDomain(0, domain)
    
    a.append(s)
# ---------- end python_3 ----------

# ---- group: in reality, must be done manually
python_4 = GhPythonScript(surfaces=srf, u_num=number_slider_2)  # -> out, organized_surfaces; inputs surfaces: list of Surface, u_num: Int32
# ---------- python_4: Python ----------
__author__ = "ytakzk"
__version__ = "2019.02.20"

import Rhino.Geometry as rg

organized_surfaces = []

for i, s in enumerate(surfaces):
    
    x = i % u_num
    y = int(i / u_num)
    
    domain = rg.Interval(0, 1)
    
#    if (x + y) % 2 == 1:
#        s = s.Reverse(1)
#        s.SetDomain(1, domain)
#        s = s.Reverse(0)
#        s.SetDomain(0, domain)

    if y % 2 == 1:
#        s = s.Reverse(1)
#        s.SetDomain(1, domain)
        s = s.Reverse(0)
        s.SetDomain(0, domain)
    
    if x == u_num - 1:
        s = s.Reverse(0)
        s.SetDomain(0, domain)
        
    organized_surfaces.append(s)
# ---------- end python_4 ----------

# ---- group: one surface
item = ListItem(List=srf, Index=0, Wrap=True)
srf_4 = Surface(item)

# ----
uvn = UVN(srf=python_3.a)
python_5 = GhPythonScript(surfaces=python_4.organized_surfaces)  # -> out, beams, dowels, tmp; inputs surfaces: list of Surface
# ---------- python_5: Python ----------
__author__ = "ytakzk"
__version__ = "2019.02.23"

import sys
import Rhino.Geometry as rg

from geometry.global_network import GlobalNetwork
from geometry.local_network import LocalNetwork

import os

if os.name == 'posix':
    print "you're a Mac!"
    path_to_append = single_parent
    sys.path.append(path_to_append)

    print path_to_append

dowels = []
beams = []
tmp = []

global_network = GlobalNetwork(surfaces)

local_networks = global_network.local_networks

for local_network in local_networks:
    
    local_dowels = local_network.add_three_beams_connection()
    dowels.extend(local_dowels)

    local_dowels = local_network.add_two_beams_connection()
    dowels.extend(local_dowels)

    local_beams = [b.brep_representation(make_holes=False) for b in local_network.get_flatten_beams()]
    beams.extend(local_beams)
    

#    surfaces = list(itertools.chain.from_iterable(local_network.network_surface))
# ---------- end python_5 ----------
python_6 = GhPythonScript(toggle=Button())  # -> out, a
# ---------- python_6: Python ----------
__author__ = "ytakzk"
__version__ = "2019.01.21"

import geometry.beam as beam
import geometry.dowel as dowel
import geometry.hole as hole
import geometry.joint_holes as joint_holes
import geometry.local_network as local_network
import geometry.global_network as global_network
import geometry.surface as surface
import geometry.shared_edge as shared_edge

if toggle:
    
    reload(beam)
    reload(dowel)
    reload(hole)
    reload(joint_holes)
    reload(local_network)
    reload(global_network)
    reload(surface)
    reload(shared_edge)
# ---------- end python_6 ----------
geo = Geometry(python_5.beams)
geo_2 = Geometry(python_5.dowels)
preview = CustomPreview(
    Geometry=geo,
    Material={diffuse=RGB(0, 0, 205), emission=RGB(66, 48, 66), shine=0.5, specular=RGB(255, 255, 255), transparency=0.7})

# ==== cluster UVN
srf = ClusterInput()
number_slider = Slider(5, range=0..110)
extract_uv_vec = GhPythonScript(srf=srf)  # -> out, center_pt, u_vec, v_vec, normal; inputs srf: Surface
# ---------- extract_uv_vec: Python ----------
__author__ = "Wenqian"
__version__ = "2019.01.22"

import rhinoscriptsyntax as rs
import Rhino.Geometry as rg

srf.SetDomain(0,rg.Interval(0,1))
srf.SetDomain(1,rg.Interval(0,1))

center_pt = srf.PointAt(0.5,0.5)

u_vec = srf.FrameAt(0.5,0.5)[1].XAxis
v_vec = srf.FrameAt(0.5,0.5)[1].YAxis

normal =srf.NormalAt(0.5,0.5)
# ---------- end extract_uv_vec ----------
multiplication = Multiplication(A=extract_uv_vec.v_vec, B=500)
multiplication_2 = Multiplication(A=extract_uv_vec.normal, B=500)
multiplication_3 = Multiplication(A=extract_uv_vec.u_vec, B=500)
vdisex = VectorDisplayEx(
    Point=extract_uv_vec.center_pt,
    Vector=multiplication_3,
    Colour=ColourSwatch(SwatchColor=RGB(255, 0, 0)),
    Width=number_slider)
vdisex_2 = VectorDisplayEx(
    Point=extract_uv_vec.center_pt,
    Vector=multiplication,
    Colour=ColourSwatch(SwatchColor=RGB(33, 220, 0)),
    Width=number_slider)
vdisex_3 = VectorDisplayEx(
    Point=extract_uv_vec.center_pt,
    Vector=multiplication_2,
    Colour=ColourSwatch(SwatchColor=RGB(255, 255, 255)),
    Width=number_slider)
